# Grasshopper definition 01 attractor vs repulsive points.gh (Grasshopper 0.9.76)

# ---- group: attractor vs repulsive points
pt = Point([<point referenced from the Rhino model> x2])

# ----
# Bio-Inspired Mask Design
# Behnaz Farahi
# 
# Attractor Points/Curve
# Summer 2020
# Digital Futures
srf = Surface(<surface referenced from the Rhino model>)
sdivide = DivideSurface(Surface=srf, UCount=Slider(59, range=0..100), VCount=Slider(17, range=0..100))  # -> flatten(Points), flatten(Normals), Parameters
pull = PullPoint(Point=sdivide.Points, Geometry=pt, ClosestOnly=True)  # -> ClosestPoint, Distance
panel = Panel(pull.Distance)

division = Division(A=pull.Distance, B=Slider(34, range=0..100))
panel_2 = Panel(division)
min = Minimum(A=division, B=Slider(3, range=0..100))

bnd = Bounds(Numbers=min)
dedomain = DeconstructDomain(Domain=min)  # -> Start, End
dom = ConstructDomain(DomainStart=dedomain.End, DomainEnd=dedomain.Start)
remap = RemapNumbers(Value=min, Source=bnd, Target=dom)  # -> Mapped, Clipped
panel_3 = Panel(remap.Mapped)

# ---- group: Changing this value will switch between attractor vs repulsive
filter = StreamFilter(Gate=Slider(0, range=0..1), Stream0=min, Stream1=remap.Mapped)

# ----
circle = CircleCNR(Center=sdivide.Points, Normal=sdivide.Normals, Radius=filter)

# ---- group: 3D geometries
scale = Scale(Geometry=circle, Center=sdivide.Points, Factor=Slider(1.9, range=0..10))  # -> Geometry, Transform
scale_2 = Scale(Geometry=circle, Center=sdivide.Points, Factor=Slider(0.2, range=0..10))  # -> Geometry, Transform
amp = Amplitude(Vector=sdivide.Normals, Amplitude=Slider(9, range=0..100))
amp_2 = Amplitude(Vector=sdivide.Normals, Amplitude=Slider(15, range=0..100))
move = Move(Geometry=scale.Geometry, Motion=expr("-x", amp))  # -> simplify(graft(Geometry)), Transform
crv = Curve(simplify(graft(circle)))
move_2 = Move(Geometry=scale_2.Geometry, Motion=expr("-x", amp_2))  # -> simplify(graft(Geometry)), Transform

loft = Loft(
    Curves=[crv, move.Geometry, move_2.Geometry],
    Options={Adjust=False, Closed=False, LoftEnds=0, LoftSimp=0, LoftType=0, Rebuild=10, Refit=0.01})

# ----
cap = CapHoles(Brep=loft)
