# Grasshopper definition 02 Vector Feilds.gh (Grasshopper 0.9.76)

# ---- group: attractor vs repulsive points
pt = Point([Point(12.23120202, 55.95156443, 0), Point(1.923689613, 3.763312043, 0), Point(37.75438419, 19.11417865, 0), Point(37.75438419, 50.72833798, 0)])

# ----
# Bio-Inspired Mask Design
# Behnaz Farahi
# 
# Vector Feilds
# Summer 2020
# Digital Futures
number_slider = Slider(57, range=0..100)
recgrid = Rectangular(Plane=PlaneXY(0, 0, 0), SizeX=1, SizeY=2, ExtentX=number_slider, ExtentY=Slider(29, range=0..100))  # -> Cells, flatten(Points)
line = LineSDL(Start=recgrid.Points, Direction=Vector(0, 0, 1), Length=Slider(50, range=0..100))
end = EndPoints(Curve=line)  # -> Start, End
genes = GenePool(Decimals=2, Maximum=1, Minimum=0, Value=[1, 0])
genes_2 = GenePool(Decimals=2, Maximum=1, Minimum=0, Value=[1, 0])

# ---- group: Rotation
pull = PullPoint(Point=recgrid.Points, Geometry=pt, ClosestOnly=True)  # -> ClosestPoint, Distance
division = Division(A=pull.Distance, B=Slider(0.2, range=0..10))
rad = Radians(Degrees=division)
rotate = Rotate(Geometry=end.End, Angle=rad, Plane=pt)  # -> Geometry, Transform

# ---- group: define the vector from attractors to the lines
vec2pt = Vector2Pt(PointA=pt, PointB=end.End, Unitize=False)  # -> Vector, Length

# ----
division_2 = Division(A=pull.Distance, B=Slider(0.5, range=0..10))
max = Maximum(A=division_2, B=Slider(0, range=0..100))
amp = Amplitude(Vector=vec2pt.Vector, Amplitude=max)
move = Move(Geometry=rotate.Geometry, Motion=amp)  # -> Geometry, Transform
ln = Line(StartPoint=move.Geometry, EndPoint=end.Start)
vpipe = PipeVariable(Curve=ln, Parameters=genes_2, Radii=genes, Caps=0)
