# Grasshopper definition 03 Lines and Vector Forces.gh (Grasshopper 0.9.76)

srf = Surface(<surface referenced from the Rhino model>)
# Bio-Inspired Mask Design
# Behnaz Farahi
# 
# Lines and Vector Forces
# Summer 2020
# Digital Futures
pt = Point([Point(68.17991726, -22.03545398, 0), Point(45.64040153, -22.12458491, 0), Point(67.26945669, -5.011018863, 0), Point(50.25222568, -5.672753957, 0)])
X = UnitX(Factor=1)
contour = Contour(Shape=srf, Point=Point(76.35676363, -29.20924406, 0), Direction=X, Distance=Slider(1, range=0..10))
cir = Circle(Plane=pt, Radius=1)
genes = GenePool(Decimals=2, Maximum=100, Minimum=0, Value=[47.5, 100, 20, 37.33])
eval = EvaluateCurve(Curve=reparameterize(cir), Parameter=Slider(0.4, range=0..1))  # -> Point, Tangent, Angle
divide = DivideCurve(Curve=contour, Count=Slider(12, range=0..100), Kinks=False)  # -> Points, Tangents, Parameters
ln = Line(StartPoint=cir, EndPoint=eval.Point)
fspin = SpinForce(Plane=pt, Strength=genes, Radius=5, Decay=Slider(1.2, range=0..10))
fvector = VectorForce(Line=ln)
mergef = MergeFields(Fields=[fvector, fspin])
fline = FieldLine(Field=mergef, Point=divide.Points, Steps=1000, Accuracy=0.1, Method=3)  # -> flatten(Curve)
