# Grasshopper definition 04 Weaving Curves.gh (Grasshopper 0.9.76)

# ----
# Bio-Inspired Mask Design
# Behnaz Farahi
# 
# Weaving Curves
# Summer 2020
# Digital Futures
srf = Surface(<surface referenced from the Rhino model>)
Y = UnitY(Factor=1)
contour = Contour(Shape=srf, Point=Point(100.8136216, 110.9890822, 0), Direction=Y, Distance=Slider(2, range=0..10))  # -> flatten(Contours)
shift = ShiftList(List=contour, Shift=1, Wrap=False)
number_slider = Slider(28, range=0..100)
dispatch = Dispatch(List=contour, DispatchPattern=[True, False])  # -> ListA, ListB
dispatch_2 = Dispatch(List=shift, DispatchPattern=[True, False])  # -> ListA, ListB
crv = Curve(dispatch.ListA)
crv_2 = Curve(dispatch.ListB)
crv_3 = Curve(dispatch_2.ListA)
crv_4 = Curve(dispatch_2.ListB)
divide = DivideCurve(Curve=crv, Count=number_slider, Kinks=False)  # -> Points, Tangents, Parameters
divide_2 = DivideCurve(Curve=crv_2, Count=number_slider, Kinks=False)  # -> Points, Tangents, Parameters
divide_3 = DivideCurve(Curve=crv_3, Count=number_slider, Kinks=False)  # -> Points, Tangents, Parameters
divide_4 = DivideCurve(Curve=crv_4, Count=number_slider, Kinks=False)  # -> Points, Tangents, Parameters
panel = Panel("""False
True""")
panel_2 = Panel("""True
False""")
panel_3 = Panel("""False
True""")
panel_4 = Panel("""True
False""")
cull = CullPattern(List=divide.Points, CullPattern=panel)
cull_2 = CullPattern(List=divide_2.Points, CullPattern=panel_2)
cull_3 = CullPattern(List=divide_4.Points, CullPattern=panel_3)
cull_4 = CullPattern(List=divide_3.Points, CullPattern=panel_4)
weave = Weave(Pattern=[0, 1], Stream0=cull_2, Stream1=cull, NullGaps=False)
weave_2 = Weave(Pattern=[0, 1], Stream0=cull_4, Stream1=cull_3, NullGaps=False)
intcrv = Interpolate(Vertices=weave_2, Degree=3, Periodic=False, KnotStyle=1)  # -> Curve, Length, Domain
intcrv_2 = Interpolate(Vertices=weave, Degree=3, Periodic=False, KnotStyle=1)  # -> Curve, Length, Domain
