# Grasshopper definition 06 Component Aggregation.gh (Grasshopper 0.9.76)

geo = Geometry([<brep referenced from the Rhino model> x2])
# Bio-Inspired Mask Design
# Behnaz Farahi
# 
# Component Aggregation
# Summer 2020
# Digital Futures
srf = Surface(<surface referenced from the Rhino model>)
group = Group(Objects=geo)
divide = DivideDomain²(Domain=srf, UCount=Slider(27, range=0..100), VCount=Slider(11, range=0..100))
md_slider = MDSlider(slider_value=Point(0.5, 0.5, 0.5), SliderMode=0, x_domain=Domain(0, 1), y_domain=Domain(0, 1), z_domain=Domain(0, 1))
bbox = BoundingBox(Content=group, Plane=PlaneXY(0, 0, 0))  # -> Box, Box_2
debrep = DeconstructBrep(Brep=bbox.Box)  # -> Faces, Edges, Vertices
subsrf = Isotrim(Surface=srf, Domain=divide)
item = ListItem(List=debrep.Faces, Index=Slider(4, range=0..10), Wrap=True)
debox = DeconstructBox(Box=bbox.Box)  # -> Plane, X, Y, Z
evalsrf = EvaluateSurface(Surface=reparameterize(subsrf), Point=md_slider)  # -> Point, Normal, Frame
evalsrf_2 = EvaluateSurface(Surface=reparameterize(item), Point=md_slider)  # -> Point, Normal, Frame
sbox = SurfaceBox(Surface=srf, Domain=subsrf, Height=debox.Z)

# ---- group: For production of components
genes = GenePool(Decimals=2, Maximum=1, Minimum=0, Value=[0, 0.57, 1])
genes_2 = GenePool(Decimals=2, Maximum=1, Minimum=0, Value=[0, 1, 0])
crv = Curve(<curve referenced from the Rhino model>)
vpipe = PipeVariable(Curve=reparameterize(crv), Parameters=genes, Radii=genes_2, Caps=0)

# ---- group: Note the differet results
orient = Orient(Geometry=group, Source=evalsrf_2.Frame, Target=evalsrf.Frame)  # -> Geometry, Transform
boxmap = BoxMapping(Geometry=group, Source=bbox.Box, Target=sbox)  # -> Geometry, Transform
