# Grasshopper definition 07 Surface analysis and Image Sampler.gh (Grasshopper 0.9.76)
# plug-ins: SonicFlow

# ----
# Circle packing based on Surface Curviture
number_slider = Slider(63, range=0..100)
# Bio-Inspired Mask Design
# Behnaz Farahi
# 
# Surface analysis and Image Sampler
# Summer 2020
# Digital Futures
srf = Surface(<surface referenced from the Rhino model>)
sdivide = DivideSurface(Surface=srf, UCount=number_slider, VCount=Slider(49, range=0..100))  # -> Points, Normals, Parameters
Z = UnitZ(Factor=1)
addition = Addition(A=number_slider, B=Slider(1, range=0..1))
number_slider_2 = Slider(12, range=0..100)
number_slider_3 = Slider(55, range=0..100)

# ---- group: Make sure the X & Y Domain of your surface is equal to the setting here
image = ImageSampler(
    sdivide.Parameters,
    FilePath="C:\Users\farah\Desktop\make-smile-photoshop-liquify-f.jpg",
    Filter="Value",
    Interpolate=False,
    Umax=63,
    Umin=0,
    Vmax=49,
    Vmin=0,
    Wrap=0)

# ----
multiplication = Multiplication(A=image, B=Slider(20, range=0..50))
amp = Amplitude(Vector=Z, Amplitude=multiplication)
move = Move(Geometry=sdivide.Points, Motion=amp)  # -> flatten(Geometry), Transform

# ---- group: Surface from an image
srfgrid = SurfaceFromPoints(Points=move.Geometry, UCount=addition, Interpolate=False)

# ----
srf_2 = Surface(srfgrid)
number_slider_4 = Slider(40, range=0..100)
sdivide_2 = DivideSurface(Surface=srf_2, UCount=number_slider_4, VCount=number_slider_4)  # -> Points, Normals, Parameters
flow = Flow(Surface=srf_2, Point3D=sdivide_2.Points, Double=Slider(4.416, range=0..10), Integer=Slider(35, range=0..50))  # -> graft(Curves)

divide = DivideDomain²(Domain=srfgrid, UCount=number_slider_3, VCount=number_slider_3)
subsrf = Isotrim(Surface=srfgrid, Domain=divide)
debrep = DeconstructBrep(Brep=subsrf)  # -> Faces, Edges, Vertices
item = ListItem(List=debrep.Vertices, Index=0, Wrap=True)
item_2 = ListItem(List=debrep.Vertices, Index=Slider(1, range=0..10), Wrap=True)
item_3 = ListItem(List=debrep.Vertices, Index=Slider(2, range=0..10), Wrap=True)
item_4 = ListItem(List=debrep.Vertices, Index=Slider(3, range=0..10), Wrap=True)
srf4pt = _4PointSurface(CornerA=item, CornerB=item_2, CornerC=item_3, CornerD=item_4)
area = Area(Geometry=srf4pt)  # -> Area, Centroid
srf_cp = SurfaceClosestPoint(Point=area.Centroid, Surface=srfgrid)  # -> Point, UVPoint, Distance
evalsrf = EvaluateSurface(Surface=srfgrid, Point=srf_cp.UVPoint)  # -> Point, Normal, Frame
curvature = SurfaceCurvature(Surface=srfgrid, Point=srf_cp.UVPoint)  # -> Frame, Gaussian, Mean
circle = CircleCNR(Center=area.Centroid, Normal=evalsrf.Normal, Radius=1)
graph = GraphMapper(
    curvature.Mean,
    x0=0.01,
    x1=1,
    y0=0.01,
    y1=1,
    container_name="Sine",
    Equation_px=[0, 0.07681230456],
    Equation_py=[0, 0.6927534342])
scale = Scale(Geometry=circle, Center=area.Centroid, Factor=graph)  # -> Geometry, Transform
