# Grasshopper definition 08 Kangaroo.gh (Grasshopper 0.9.76)
# plug-ins: Kangaroo Components

# ---- group: Attractor point
pt = Point(<point referenced from the Rhino model>)

# ---- group: Vertical force point
pt_2 = Point(<point referenced from the Rhino model>)

# ----
# Bio-Inspired Mask Design
# Behnaz Farahi
# 
# Kangaroo
# Summer 2020
# Digital Futures
srf = Surface(<surface referenced from the Rhino model>)
pt_3 = Point(Point(0.2922563321, 215.7278139, 0))
timer = Timer(TimerInterval=1000, Target=kangaroo)  # disabled
srf_2 = Surface(<surface referenced from the Rhino model>)

# ---- group: Anchor points
number_slider = Slider(40, range=0..100)
hexgrid = Hexagonal(Plane=pt_3, Size=1, ExtentX=number_slider, ExtentY=number_slider)  # -> Cells, Points
group = Group(Objects=flatten(hexgrid.Cells))
bbox = BoundingBox(Content=group, Plane=PlaneXY(0, 0, 0))  # -> Box, Box_2
map_srf = MapToSurface(Curve=hexgrid.Cells, Source=bbox.Box, Target=srf)
edges = BrepEdges(Brep=srf)  # -> Naked, Interior, NonManifold
crv = Curve(graft(map_srf))
ccx = CurveCurve(CurveA=edges.Naked, CurveB=crv)  # -> flatten(Points), ParamsA, ParamsB

# ---- group: Springiness
explode = Explode(Curve=map_srf, Recursive=True)  # -> Segments, Vertices
dupln = RemoveDuplicateLines(Lines=flatten(explode.Segments), Tolerance=0.01)
curvepoint = PointOnCurve(dupln, parameter=0.5)
pull = PullPoint(Point=curvepoint, Geometry=pt, ClosestOnly=True)  # -> ClosestPoint, Distance
len = Length(Curve=dupln)
division = Division(A=pull.Distance, B=Slider(34, range=0..100))
subtraction = Subtraction(A=len, B=division)
springs = SpringsFromLine(Connection=dupln, Stiffness=1000, Damping=10, RestLength=subtraction, UpperCutoff=0, LowerCutoff=0, Plasticity=0)

# ---- group: Vertical Force
curvepoint_2 = PointOnCurve(dupln, parameter=1)
pull_2 = PullPoint(Point=curvepoint_2, Geometry=pt_2, ClosestOnly=True)  # -> ClosestPoint, Distance
smaller = SmallerThan(FirstNumber=pull_2.Distance, SecondNumber=Slider(16, range=0..100))  # -> SmallerThan, OrEqualTo
cull = CullPattern(List=pull_2.Distance, CullPattern=smaller.SmallerThan)
multiplication = Multiplication(A=cull, B=Slider(41, range=0..100))
cull_2 = CullPattern(List=curvepoint_2, CullPattern=smaller.SmallerThan)
Z = UnitZ(Factor=multiplication)
uforce = UnaryForce(Point=cull_2, Force=Z)

# ----
kangaroo = KangarooPhysics(ForceObjects=flatten([springs, uforce]), AnchorPoints=ccx.Points, Settings=null, Geometry=dupln, SimulationReset=True)  # -> Out, Iterations, ParticlesOut, GeometryOut, KE
crv_2 = Curve(kangaroo.GeometryOut)
map_srf_2 = MapToSurface(Curve=crv_2, Source=srf, Target=srf_2)
