# Grasshopper definition 08-2 Kangaroo Perline noise.gh (Grasshopper 0.9.76)
# plug-ins: Kangaroo Components, Weaverbird, Noise 4D

# ----
# Bio-Inspired Mask Design
# Behnaz Farahi
# 
# Kangaroo
# Perline Noise
# Summer 2020
# Digital Futures
geo = Geometry(<brep referenced from the Rhino model>)
number_slider = Slider(30, range=0..100)
mesh_uv = MeshSurface(Surface=geo, UCount=number_slider, VCount=number_slider, Overhang=True, Equalize=False)
demesh = DeconstructMesh(Mesh=mesh_uv)  # -> Vertices, Faces, Colours, Normals
perlin = PerlinNoise(Values=demesh.Vertices, Time=0, Scale=Slider(0.232, range=0..1))
Z = UnitZ(Factor=perlin)
bnd = Bounds(Numbers=perlin)
uforce = UnaryForce(Point=graft(demesh.Vertices), Force=graft(Z))
dedomain = DeconstructDomain(Domain=bnd)  # -> Start, End
gradient = Gradient(
    LowerLimit=dedomain.Start,
    UpperLimit=dedomain.End,
    Parameter=perlin,
    stops=[0: RGB(34, 205, 189), 0.589: RGB(255, 255, 0), 1: RGB(255, 0, 0)])
kangaroo = KangarooPhysics(ForceObjects=flatten(uforce), Settings=null, Geometry=demesh.Vertices, SimulationReset=True)  # -> Out, Iterations, ParticlesOut, GeometryOut, KE
timer = Timer(TimerInterval=20, Target=kangaroo)
conmesh = ConstructMesh(Vertices=kangaroo.GeometryOut, Faces=demesh.Faces, Colours=gradient)
geo_2 = Geometry(kangaroo.GeometryOut)
wbcatmullclark = WeaverbirdsCatmullClarkSubdivision(MeshCurves=conmesh, Level=2, SmoothNakedEdges=0)
preview = CustomPreview(Geometry=geo_2, Shader=gradient)
