# Grasshopper definition 09 Growth Anemone.gh (Grasshopper 0.9.76)
# plug-ins: Anemone

# ----
# Bio-Inspired Mask Design
# Behnaz Farahi
# 
# Growth: Anemone
# Summer 2020
# Digital Futures
pt = Point(<point referenced from the Rhino model>)
number_slider = Slider(405, range=0..1000)
dom = ConstructDomain(DomainStart="-2", DomainEnd="2")
dom_2 = ConstructDomain(DomainStart="-2", DomainEnd="2")
dom_3 = ConstructDomain(DomainStart="-2", DomainEnd="2")
multiplication = Multiplication(A=number_slider, B=Slider(300, range=0..1000))
multiplication_2 = Multiplication(A=number_slider, B=Slider(300, range=0..1000))
random = Random(Range=dom, Number=1, Seed=number_slider)
random_2 = Random(Range=dom_3, Number=1, Seed=multiplication_2)
random_3 = Random(Range=dom_2, Number=1, Seed=multiplication)
vec = VectorXYZ(XComponent=random, YComponent=random_3, ZComponent=random_2)  # -> Vector, Length
unit = UnitVector(Vector=vec.Vector)
move = Move(Geometry=pt, Motion=unit)  # -> Geometry, Transform

pt_2 = Point(<point referenced from the Rhino model>)
loop_start = LoopStart(Repeat=Slider(500, range=0..500), Data=pt_2)  # -> port, Counter, Data
multiplication_3 = Multiplication(A=loop_start.Counter, B=Slider(16, range=0..1000))
dom_4 = ConstructDomain(DomainStart="-100", DomainEnd="100")
multiplication_4 = Multiplication(A=loop_start.Counter, B=Slider(11, range=0..1000))
multiplication_5 = Multiplication(A=loop_start.Counter, B=Slider(26, range=0..1000))
random_4 = Random(Range=dom_4, Number=1, Seed=multiplication_4)
random_5 = Random(Range=dom_4, Number=1, Seed=multiplication_5)
random_6 = Random(Range=dom_4, Number=1, Seed=multiplication_3)
vec_2 = VectorXYZ(XComponent=random_6, YComponent=random_4, ZComponent=random_5)  # -> Vector, Length
unit_2 = UnitVector(Vector=vec_2.Vector)
move_2 = Move(Geometry=loop_start.Data, Motion=unit_2)  # -> Geometry, Transform
loop_end = LoopEnd(
    port=loop_start.port,
    Exit=False,
    Data=flatten(move_2.Geometry),
    pausedState=False,
    state="Constant & Record",
    TimeOutVal=0)  # -> flatten(Data)
intcrv = Interpolate(Vertices=loop_end, Degree=3, Periodic=False, KnotStyle=1)  # -> Curve, Length, Domain
pline = PolyLine(Vertices=loop_end, Closed=False)

number_slider_2 = Slider(50, range=0..100)
pop2d = Populate2D(Region={Plane=PlaneXY(0, 0, 0), Size=Domain2(u=0..20, v=0..10)}, Count=number_slider_2, Seed=1)
pt_3 = Point(pop2d)
loop_start_2 = LoopStart(Repeat=Slider(92, range=0..500), Data=pt_3)  # -> port, Counter, Data
multiplication_6 = Multiplication(A=loop_start_2.Counter, B=Slider(16, range=0..1000))
dom_5 = ConstructDomain(DomainStart="-100", DomainEnd="100")
multiplication_7 = Multiplication(A=loop_start_2.Counter, B=Slider(11, range=0..1000))
multiplication_8 = Multiplication(A=loop_start_2.Counter, B=Slider(26, range=0..1000))
random_7 = Random(Range=dom_5, Number=number_slider_2, Seed=multiplication_7)
random_8 = Random(Range=dom_5, Number=number_slider_2, Seed=multiplication_8)
random_9 = Random(Range=dom_5, Number=number_slider_2, Seed=multiplication_6)
vec_3 = VectorXYZ(XComponent=random_9, YComponent=random_7, ZComponent=random_8)  # -> Vector, Length
unit_3 = UnitVector(Vector=vec_3.Vector)
move_3 = Move(Geometry=loop_start_2.Data, Motion=unit_3)  # -> Geometry, Transform
loop_end_2 = LoopEnd(
    port=loop_start_2.port,
    Exit=False,
    Data=flatten(move_3.Geometry),
    pausedState=False,
    state="Constant & Record",
    TimeOutVal=0)  # -> flatten(Data)
intcrv_2 = Interpolate(Vertices=loop_end_2, Degree=3, Periodic=False, KnotStyle=1)  # -> Curve, Length, Domain
pline_2 = PolyLine(Vertices=loop_end_2, Closed=False)
