# Grasshopper definition 10 Growth Anemone Movement.gh (Grasshopper 0.9.76)
# plug-ins: Anemone

# ---- group: Curves are morphing into oneanother
crv = Curve(<curve referenced from the Rhino model>)
crv_2 = Curve(<curve referenced from the Rhino model>)
number_slider = Slider(40, range=0..100)
divide = DivideCurve(Curve=crv_2, Count=number_slider, Kinks=False)  # -> Points, Tangents, Parameters
divide_2 = DivideCurve(Curve=crv, Count=number_slider, Kinks=False)  # -> Points, Tangents, Parameters
loop_start = LoopStart(Repeat=Slider(50, range=0..100), Data=divide_2.Points)  # -> port, Counter, Data
vec2pt = Vector2Pt(PointA=loop_start.Data, PointB=divide.Points, Unitize=False)  # -> Vector, Length
amp = Amplitude(Vector=vec2pt.Vector, Amplitude=1)
move = Move(Geometry=loop_start.Data, Motion=amp)  # -> Geometry, Transform
loop_end = LoopEnd(
    port=loop_start.port,
    Exit=False,
    Data=flatten(move.Geometry),
    pausedState=False,
    state="Constant & Record",
    TimeOutVal=0)
intcrv = Interpolate(Vertices=loop_end, Degree=3, Periodic=False, KnotStyle=1)  # -> Curve, Length, Domain

# ---- group: Points are moving toward a point
# Bio-Inspired Mask Design
# Behnaz Farahi
# 
# Growth: Anemone
# Movement
# Summer 2020
# Digital Futures
number_slider_2 = Slider(18, range=0..100)
pop3d = Populate3D(
    Region={Plane=PlaneXY(0, 0, 0), X=Domain(0, 10), Y=Domain(0, 10), Z=Domain(0, 2)},
    Count=Slider(50, range=0..100),
    Seed=1)
pt = Point(<point referenced from the Rhino model>)
loop_start_2 = LoopStart(Repeat=number_slider_2, Data=pop3d)  # -> port, Counter, Data
vec2pt_2 = Vector2Pt(PointA=loop_start_2.Data, PointB=pt, Unitize=False)  # -> Vector, Length
amp_2 = Amplitude(Vector=vec2pt_2.Vector, Amplitude=1)
move_2 = Move(Geometry=loop_start_2.Data, Motion=amp_2)  # -> Geometry, Transform
loop_end_2 = LoopEnd(port=loop_start_2.port, Exit=False, Data=move_2.Geometry, pausedState=False, state="Constant & Record", TimeOutVal=0)

# ---- group: Between curves and randomness
crv_3 = Curve(<curve referenced from the Rhino model>)
crv_4 = Curve(<curve referenced from the Rhino model>)
number_slider_3 = Slider(40, range=0..100)
divide_3 = DivideCurve(Curve=crv_4, Count=number_slider_3, Kinks=False)  # -> Points, Tangents, Parameters
divide_4 = DivideCurve(Curve=crv_3, Count=number_slider_3, Kinks=False)  # -> Points, Tangents, Parameters
loop_start_3 = LoopStart(Repeat=Slider(50, range=0..100), Data=divide_4.Points)  # -> port, Counter, Data
multiplication = Multiplication(A=loop_start_3.Counter, B=Slider(25, range=0..100))
vec2pt_3 = Vector2Pt(PointA=divide_4.Points, PointB=divide_3.Points, Unitize=False)  # -> Vector, Length
random = Random(Range=loop_start_3.Counter, Number=number_slider_3, Seed=multiplication)
amp_3 = Amplitude(Vector=vec2pt_3.Vector, Amplitude=random)
move_3 = Move(Geometry=loop_start_3.Data, Motion=amp_3)  # -> Geometry, Transform
loop_end_3 = LoopEnd(
    port=loop_start_3.port,
    Exit=False,
    Data=flatten(move_3.Geometry),
    pausedState=False,
    state="Constant & Record",
    TimeOutVal=0)
intcrv_2 = Interpolate(Vertices=loop_end_3, Degree=3, Periodic=True, KnotStyle=1)  # -> flatten(Curve), Length, Domain
lng = ListLength(List=intcrv_2.Curve)
series = Series(Start=0, Step=1, Count=lng)
Z = UnitZ(Factor=1)
amp_4 = Amplitude(Vector=Z, Amplitude=series)
move_4 = Move(Geometry=intcrv_2.Curve, Motion=amp_4)  # -> Geometry, Transform
