# Grasshopper definition 11 Growth Anemone 2D branching.gh (Grasshopper 1.0.7)
# plug-ins: Anemone, Kangaroo Components, Weaverbird

# Bio-Inspired Mask Design
# Behnaz Farahi
# 
# Growth: Anemone
# 2D Branching
image = ImageSampler(
    FilePath="C:\Users\farah\Videos\Captures\surfaces.3dm (2765 KB) - Rhinoceros 5.0 Educational - [Perspective] 6_30_2020 12_30_07 PM (2).png",
    Filter="Colour",
    Interpolate=False,
    Umax=1,
    Umin=0,
    Vmax=1,
    Vmin=0,
    Wrap=1)

crv = Curve(<curve referenced from the Rhino model>)
# Summer 2020
# Digital Futures
number_slider = Slider(15, range=0..40)
loop_start = LoopStart(Repeat=number_slider, Data=crv)  # -> port, Counter, Data
explode = Explode(Curve=loop_start.Data, Recursive=True)  # -> Segments, flatten(Vertices)

# ---- group: draw a circle based on the new curve
group = Group(Objects=flatten(loop_start.Data))
bbox = BoundingBox(Content=group, Plane=PlaneXY(0, 0, 0))  # -> Box, Box_2
boxprop = BoxProperties(Box=bbox.Box)  # -> Center, Diagonal, Area, Volume, Degeneracy
division = Division(A=boxprop.Diagonal, B=Slider(1.9, range=0..10))

# ----
len = Length(Curve=crv)
multiplication = Multiplication(A=len, B=Slider(0.27, range=0..5))
dom = ConstructDomain(DomainStart=len, DomainEnd=multiplication)
remap = RemapNumbers(Value=loop_start.Counter, Source=number_slider, Target=dom)  # -> Mapped, Clipped

cir = Circle(Plane=boxprop.Center, Radius=division)

multiplication_2 = Multiplication(A=loop_start.Counter, B=Slider(30, range=0..100))
multiplication_3 = Multiplication(A=loop_start.Counter, B=Slider(8, range=0..10))
random = Random(Range=Domain(0, 1), Number=multiplication_3, Seed=multiplication_2)
eval = EvaluateCurve(Curve=reparameterize(cir), Parameter=random)  # -> Point, Tangent, Angle

# ---- group: find a closest point from circle to points on our curve
cp = ClosestPoint(Point=eval.Point, Cloud=explode.Vertices)  # -> ClosestPoint, CPIndex, Distance

# ---- group: draw new lines
vec2pt = Vector2Pt(PointA=cp.ClosestPoint, PointB=eval.Point, Unitize=False)  # -> Vector, Length
division_2 = Division(A=vec2pt.Length, B=Slider(3.3, range=0..10))
line = LineSDL(Start=cp.ClosestPoint, Direction=vec2pt.Vector, Length=remap.Mapped)

# ----
merge = Merge(Data1=flatten(line), Data2=flatten(loop_start.Data))  # -> flatten(Result)
loop_end = LoopEnd(port=loop_start.port, Exit=False, Data=flatten(merge), TimeOutVal=0, pausedState=False, state="Constant output")

crv_2 = Curve(flatten(loop_end))
dupln = RemoveDuplicateLines(Tolerance=0.01)

crv_3 = Curve(dupln)
group_2 = Group(Objects=crv_3)
bbox_2 = BoundingBox(Content=group_2, Plane=PlaneXY(0, 0, 0))  # -> Box, Box_2
mplane = MeshPlane(Boundary=bbox_2.Box, WidthCount=100, HeightCount=100)  # -> Mesh, Area
mcomp = Decompose(Mesh=mplane.Mesh)  # -> graft(Vertices), Faces, Colours, Normals
crv_cp = CurveCP(Point=mcomp.Vertices, Curve=crv_3)  # -> Point, Parameter, Distance
division_3 = Division(A=1, B=crv_cp.Distance)
min = Minimum(A=division_3, B=Slider(5, range=0..100))
ma = MassAddition(Input=min)  # -> Result, PartialResults
range = Range(Domain=Domain(0, 200), Steps=100)
Z = UnitZ(Factor=ma.Result)
move = Move(Geometry=mcomp.Vertices, Motion=Z)  # -> Geometry, Transform
xy = XYPlane(Origin=Point(0, 0, 0))
mesh = Mesh(Vertices=flatten(move.Geometry), Faces=mcomp.Faces)
pl_offset = PlaneOffset(BasePlane=xy, Offset=range)

wbcatmullclark = WeaverbirdsCatmullClarkSubdivision(MeshCurves=mesh, Level=3, SmoothNakedEdges=1)

sec = MeshPlane(Mesh=wbcatmullclark, Plane=pl_offset)
