# Grasshopper definition 12 Growth Anemone 2D branching constrained.gh (Grasshopper 0.9.76)
# plug-ins: Anemone

# ---- group: curve/ texts
crv = Curve(<curve referenced from the Rhino model>)

# ----
# Bio-Inspired Mask Design
# Behnaz Farahi
# 
# Growth: Anemone
# 2D Branching Constrained
image = ImageSampler(
    FilePath="C:\Users\farah\Videos\Captures\surfaces.3dm (2765 KB) - Rhinoceros 5.0 Educational - [Perspective] 6_30_2020 12_38_08 PM (2).png",
    Filter="Colour",
    Interpolate=False,
    Umax=1,
    Umin=0,
    Vmax=1,
    Vmin=0,
    Wrap=1)

# ----
# Summer 2020
# Digital Futures
number_slider = Slider(100, range=0..100)
bbox = BoundingBox(Content=crv, Plane=PlaneXY(0, 0, 0))  # -> Box, Box_2
loop_start = LoopStart(Repeat=number_slider, Data=crv)  # -> port, Counter, Data
multiplication = Multiplication(A=loop_start.Counter, B=Slider(6.6, range=0..10))

# ---- group: Check if the points are inside the curve
pop2d = Populate2D(Region=bbox.Box, Count=Slider(300, range=0..1000), Seed=multiplication)  # -> flatten(Population)
incurve = PointInCurve(Point=pop2d, Curve=crv)  # -> Relationship, Point
equals = Equality(FirstNumber=incurve.Relationship, SecondNumber="2")  # -> Equality, Inequality
cull = CullPattern(List=pop2d, CullPattern=equals.Equality)

# ---- group: draw a vector between projected points and points
pull = PullPoint(Point=cull, Geometry=loop_start.Data, ClosestOnly=True)  # -> ClosestPoint, Distance
vec2pt = Vector2Pt(PointA=pull.ClosestPoint, PointB=cull, Unitize=False)  # -> Vector, Length

# ----
division = Division(A=vec2pt.Length, B=Slider(3.4, range=0..10))
line = LineSDL(Start=pull.ClosestPoint, Direction=vec2pt.Vector, Length=division)
merge = Merge(Data1=line, Data2=loop_start.Data)  # -> flatten(Result)
loop_end = LoopEnd(port=loop_start.port, Exit=False, Data=merge, pausedState=False, state="Constant & Record", TimeOutVal=0)
