# Grasshopper definition 15 Growth Anemone Surface growth.gh (Grasshopper 0.9.76)
# plug-ins: Anemone, LunchBox

platoicosa = PlatonicIcosahedron(Plane=PlaneXY(0, 0, 0), Radius=10, Truncation=0.38198)
# Bio-Inspired Mask Design
# Behnaz Farahi
# 
# Growth: Anemone
# Surface growth
# Summer 2020
# Digital Futures
number_slider = Slider(78, range=0..200)
loop_start = LoopStart(Repeat=number_slider, Data=platoicosa)  # -> port, Counter, Data
bbox = BoundingBox(Content=platoicosa, Plane=PlaneXY(0, 0, 0))  # -> Box, Box_2
boxprop = BoxProperties(Box=bbox.Box)  # -> Center, Diagonal, Area, Volume, Degeneracy
division = Division(A=boxprop.Diagonal, B=Slider(1.9, range=0..10))
multiplication = Multiplication(A=loop_start.Counter, B=Slider(831, range=0..1000))
sph = Sphere(Base=boxprop.Center, Radius=division)
random = Random(Range=Domain(0, 0.5), Number="3", Seed=multiplication)
debrep = DeconstructBrep(Brep=loop_start.Data)  # -> flatten(Faces), Edges, Vertices
item = ListItem(List=random, Index=0, Wrap=True)  # -> Item, Item1, Item2
pt = ConstructPoint(XCoordinate=item.Item, YCoordinate=item.Item1, ZCoordinate=item.Item2)
area = Area(Geometry=debrep.Faces)  # -> Area, flatten(Centroid)
evalsrf = EvaluateSurface(Surface=reparameterize(sph), Point=pt)  # -> Point, Normal, Frame
cp = ClosestPoint(Point=evalsrf.Point, Cloud=area.Centroid)  # -> ClosestPoint, CPIndex, Distance
item_2 = ListItem(List=debrep.Faces, Index=cp.CPIndex, Wrap=True)
explode = Explode(Curve=item_2, Recursive=True)  # -> Segments, Vertices
cull_i = CullIndex(List=debrep.Faces, Indices=cp.CPIndex, Wrap=True)
item_3 = ListItem(List=explode.Vertices, Index=0, Wrap=True)  # -> Item, Item1, Item2, Item3
srf4pt = _4PointSurface(CornerA=item_3.Item1, CornerB=evalsrf.Point, CornerC=item_3.Item2)
srf4pt_2 = _4PointSurface(CornerA=item_3.Item, CornerB=item_3.Item1, CornerC=evalsrf.Point)
srf4pt_3 = _4PointSurface(CornerA=item_3.Item2, CornerB=item_3.Item3, CornerC=evalsrf.Point)
join = BrepJoin(Breps=flatten([srf4pt, srf4pt_2, srf4pt_3]))  # -> Breps, Closed
merge = Merge(Data1=join.Breps, Data2=cull_i)
loop_end = LoopEnd(port=loop_start.port, Exit=False, Data=flatten(merge), pausedState=False, state="Constant & Record", TimeOutVal=0)
