# Grasshopper definition 16 VornoiSimple.gh (Grasshopper 1.0.7)

# ---- group: Cell radius
number_slider = Slider(9, range=0..20)

# ---- group: Fillet radius
number_slider_2 = Slider(2, range=0..20)

# ----
pop2d = Populate2D(Region={Plane=PlaneXY(0, 0, 0), Size=Domain2(u=0..20, v=0..10)}, Count=100, Seed=1)
box = Box({Plane=PlaneXY(-14.39693837, -6.568011791, 0), X=Domain(0, 34.47087152), Y=Domain(0, 40.04188403), Z=Domain(0, 1)})
voronoi = Voronoi(Points=pop2d, Radius=number_slider, Boundary=box, BruteForceOverride=False)

# ---- group: Offset distance
slider = Slider(0.513, range=0..1)

# ----
fillet = Fillet(Curve=voronoi, Radius=number_slider_2)
graft = GraftTree(Data=fillet, Strip=False)
offset = Offset(Curve=fillet, Distance=expr("-x", slider), Plane=PlaneXY(0, 0, 0), Corners=1)
loft = Loft(
    Section=[offset, graft],
    Options={Adjust=False, Closed=False, LoftEnds=0, LoftSimp=0, LoftType=0, Rebuild=10, Refit=0.01})
