# Grasshopper definition 17 VoroonoisSurface.gh (Grasshopper 0.9.76)

rec = Rectangle({Plane=PlaneXY(-11.12081253, -5.04643552, 0), Size=Domain2(u=0..31.58584589, v=0..24.60391983)})
pt = Point(Point(4.517864707, 1.997714276, 0))
pop2d = Populate2D(Region=rec, Count=100, Seed=1)
pull = PullPoint(Point=pop2d, Geometry=pt, ClosestOnly=True)  # -> ClosestPoint, Distance
voronoi = Voronoi(Points=pop2d, Boundary=rec, BruteForceOverride=False)
division = Division(A=pull.Distance, B=Slider(26, range=0..100))
min = Minimum(A=division, B=Slider(67, range=0..100))
pt_2 = Point(pt)
bnd = Bounds(Numbers=min)
panel = Panel(bnd)
scale = Scale(Geometry=voronoi, Center=pop2d, Factor=min)  # -> graft(Geometry), Transform
pull_2 = PullPoint(Point=pop2d, Geometry=pt_2, ClosestOnly=True)  # -> ClosestPoint, Distance
division_2 = Division(A=pull_2.Distance, B=Slider(4, range=0..100))
min_2 = Minimum(A=division_2, B=Slider(8, range=0..100))  # -> graft(Result)
Z = UnitZ(Factor=1)
amp = Amplitude(Vector=Z, Amplitude=min_2)
move = Move(Geometry=scale.Geometry, Motion=amp)  # -> Geometry, Transform
crv = Curve(graft(voronoi))
panel_2 = Panel(min_2)
loft = Loft(
    Curves=[move.Geometry, crv],
    Options={Adjust=False, Closed=False, LoftEnds=0, LoftSimp=0, LoftType=0, Rebuild=10, Refit=0.01})
